# Dynamo graph Align.dyn (Dynamo 2.1.1.7865)

current = Autodesk.AutoCAD.DynamoNodes.Document.Current()
boolean = BoolSelector(false)
getAllAlignments = IterisCivilDynamo.Alignments.Alignment.GetAllAlignments(document=current, allowReference=boolean)
integer_slider = IntegerSlider(0, range=0..100 step 1)
getItemAtIndex = List.GetItemAtIndex(list=getAllAlignments, index=integer_slider)
getCurves = IterisCivilDynamo.Alignments.Alignment.GetCurves(alignment=getItemAtIndex)
integer_slider_2 = IntegerSlider(0, range=0..100 step 1)
getItemAtIndex_2 = List.GetItemAtIndex(list=getCurves, index=integer_slider_2)
