# Dynamo graph Home.dyn (Dynamo 2.1.1.7865)

current = Autodesk.AutoCAD.DynamoNodes.Document.Current()
currentLayer = Autodesk.AutoCAD.DynamoNodes.Document.CurrentLayer(document=current)
modelSpace = Autodesk.AutoCAD.DynamoNodes.Document.ModelSpace(document=current)
all_objects_on_layer = AcObjectsOnLayer(layer=currentLayer, block=modelSpace)
createAnonymousGroup = IterisCivilDynamo.Drawings.Utils.CreateAnonymousGroup(objects=all_objects_on_layer)
